# Grasshopper definition five parts.gh (Grasshopper 0.9.76)
# plug-ins: horsterCameraControl

Z = UnitZ(Factor=1)
tube_wall_thickness = Slider(2, range=0..10)
sensor_tube_height = Slider(64, range=40..100)
lens_tube_height = Slider(63, range=40..100)
pi_tube_height = Slider(101, range=70..200)
tube_radius = Slider(40, range=0..100)
cam_plug_height = Slider(10, range=10..30)

# ---- group: camera position tweak
addition = Addition(A=pi_tube_height, B=Slider(6.7, range=0..11))

# ---- group: base plug controls
pi_recess_depth = Slider(18, range=0..100)
pi_screw_height = Slider(11, range=0..15)
through_cut = Slider(11, range=0..15)
baseplugheight = Slider(20, range=0..100)
post_outside_rad = Slider(10, range=0..10)

# ----
lens_groove_depth = Slider(3, range=0..10)
xy = XYPlane(Origin=Point(0, 0, 0))
cam_lens_radius = Slider(5.2, range=3..10)
cameramesh = Mesh([<mesh referenced from the Rhino model> x9])
post = Slider(104, range=0..180)
Z_2 = UnitZ(Factor=addition)
pl_offset = PlaneOffset(BasePlane=xy, Offset=expr("x*-1", sensor_tube_height))
pl_offset_2 = PlaneOffset(BasePlane=xy, Offset=pi_tube_height)
move = Move(Geometry=pl_offset_2, Motion=Z)  # -> Geometry, Transform
setcam = SetCamera(
    CameraLocation=pl_offset_2,
    TargetLocation=move.Geometry,
    LensLength=Slider(18, range=5..60),
    UpDirection=Z,
    Activate=True)
pt = Point(<point referenced from the Rhino model>)
move_2 = Move(Geometry=cameramesh, Motion=Z_2)  # -> Geometry, Transform

addition_2 = Addition(A=tube_radius, B=tube_wall_thickness)
Z_3 = UnitZ(Factor=cam_plug_height)
cir = Circle(Plane=pl_offset_2, Radius=addition_2)
move_3 = Move(Geometry=cir, Motion=expr("x*-0.5", Z_3))  # -> Geometry, Transform
boundary = BoundarySurfaces(Edges=move_3.Geometry)
extr = Extrude(Base=boundary, Direction=Z_3)

# ---- group: port holes
crv = Curve([<curve referenced from the Rhino model> x3])
Z_4 = UnitZ(Factor=through_cut)
boundary_2 = BoundarySurfaces(Edges=crv)
extr_2 = Extrude(Base=boundary_2, Direction=Z_4)

# ---- group: pi recess
crv_2 = Curve([<curve referenced from the Rhino model> x4])
Z_5 = UnitZ(Factor=baseplugheight)
move_4 = Move(Geometry=crv_2, Motion=Z_5)  # -> Geometry, Transform
Z_6 = UnitZ(Factor=expr("-x", pi_recess_depth))
boundary_3 = BoundarySurfaces(Edges=move_4.Geometry)
extr_3 = Extrude(Base=boundary_3, Direction=Z_6)
sunion = SolidUnion(Breps=extr_3)

# ---- group: screw posts
crv_3 = Curve([<curve referenced from the Rhino model> x3])
Z_7 = UnitZ(Factor=baseplugheight)
move_5 = Move(Geometry=crv_3, Motion=Z_7)  # -> Geometry, Transform
Z_8 = UnitZ(Factor=pi_screw_height)
boundary_4 = BoundarySurfaces(Edges=move_5.Geometry)
extr_4 = Extrude(Base=boundary_4, Direction=Z_8)

# ----
pln = Plane(pl_offset_2)
cir_2 = Circle(Plane=pt, Radius=post_outside_rad)

# ---- group: base plug mass
subtraction = Subtraction(A=tube_radius, B=tube_wall_thickness)
cir_3 = Circle(Plane=PlaneXY(0, 0, 0), Radius=subtraction)
boundary_5 = BoundarySurfaces(Edges=[cir_3, cir_2])
Z_9 = UnitZ(Factor=baseplugheight)
extr_5 = Extrude(Base=boundary_5, Direction=Z_9)

# ----
subtraction_2 = Subtraction(A=tube_radius, B=tube_wall_thickness)
Z_10 = UnitZ(Factor=cam_plug_height)
Z_11 = UnitZ(Factor=lens_groove_depth)
cir_4 = Circle(Plane=pl_offset_2, Radius=subtraction_2)
cir_5 = Circle(Plane=pl_offset_2, Radius=tube_radius)
move_6 = Move(Geometry=[cir_4, cir_5], Motion=expr("x*0.5", Z_10))  # -> Geometry, Transform
boundary_6 = BoundarySurfaces(Edges=move_6.Geometry)
extr_6 = Extrude(Base=boundary_6, Direction=expr("-x", Z_11))

cp = PlaneClosestPoint(Point=pt, Plane=pln)  # -> Point, UVPoint, Distance

# ---- group: lens hole
cir_6 = Circle(Plane=pln, Radius=cam_lens_radius)
Z_12 = UnitZ(Factor=100)
boundary_7 = BoundarySurfaces(Edges=cir_6)
extr_7 = Extrude(Base=boundary_7, Direction=Z_12)

# ---- group: lens tube
tube = Tube(thickness=tube_wall_thickness, od=tube_radius, height=lens_tube_height, pln=pl_offset_2)

# ---- group: pi tube
tube_2 = Tube(thickness=tube_wall_thickness, od=tube_radius, height=pi_tube_height, pln=xy)

# ---- group: sensor tube
tube_3 = Tube(thickness=tube_wall_thickness, od=tube_radius, height=sensor_tube_height, pln=pl_offset)

# ----
cir_7 = Circle(Plane=cp.Point, Radius=Slider(13, range=0..100))
boundary_8 = BoundarySurfaces(Edges=cir_2)
Z_13 = UnitZ(Factor=post)
boundary_9 = BoundarySurfaces(Edges=cir_7)

multiplication = Multiplication(A=tube_radius, B=Slider(0.9, range=0..1))
cir_8 = Circle(Plane=pln, Radius=multiplication)
Z_14 = UnitZ(Factor=cam_plug_height)
Z_15 = UnitZ(Factor=Slider(3.5, range=0..4))
rdiff = RegionDifference(CurvesA=cir_8, CurvesB=boundary_9)
boundary_10 = BoundarySurfaces(Edges=rdiff)
move_7 = Move(Geometry=boundary_10, Motion=Z_15)  # -> Geometry, Transform
extr_8 = Extrude(Base=move_7.Geometry, Direction=expr("-x", Z_14))

cir_9 = Circle(Plane=pln, Radius=tube_radius)
Z_16 = UnitZ(Factor=cam_plug_height)
rdiff_2 = RegionDifference(CurvesA=cir_9, CurvesB=boundary_9)
boundary_11 = BoundarySurfaces(Edges=rdiff_2)
extr_9 = Extrude(Base=boundary_11, Direction=expr("-x", Z_16))

extr_10 = Extrude(Base=boundary_8, Direction=Z_13)
hsl = ColourHSL(Alpha=0.1, Hue=0.5, Saturation=1, Luminance=0.5)
Z_17 = UnitZ(Factor=expr("-x", post))
cir_10 = Circle(Plane=cp.Point, Radius=post_outside_rad)
preview = CustomPreview(Geometry=[tube, tube_3, tube_2], Shader=hsl)
capex = CapHolesEx(Brep=extr_10)  # -> Brep, Caps, Solid
boundary_12 = BoundarySurfaces(Edges=cir_10)
sdiff = SolidDifference(BrepsA=extr_5, BrepsB=sunion)
move_8 = Move(Geometry=capex.Brep, Motion=Z_17)  # -> Geometry, Transform
sunion_2 = SolidUnion(Breps=flatten([extr_9, extr_8, extr_7]))
extr_11 = Extrude(Base=boundary_12, Direction=expr("-x", Z_16))
sunion_3 = SolidUnion(Breps=[capex.Brep, move_8.Geometry])
sunion_4 = SolidUnion(Breps=[sdiff, extr_4])
sdiff_2 = SolidDifference(BrepsA=sunion_4, BrepsB=extr_2)
sdiff_3 = SolidDifference(BrepsA=extr, BrepsB=sunion_2)
sdiff_4 = SolidDifference(BrepsA=sdiff_3, BrepsB=extr_6)

# ---- group: mirror
pl_offset_3 = PlaneOffset(BasePlane=pl_offset_2, Offset=lens_tube_height)
num = Number(tube_radius)
cir_11 = Circle(Plane=pl_offset_3, Radius=num)
sph = Sphere(Base=pl_offset_3, Radius=num)
boundary_13 = BoundarySurfaces(Edges=cir_11)
Z_18 = UnitZ(Factor=num)
extr_12 = Extrude(Base=boundary_13, Direction=Z_18)
sdiff_5 = SolidDifference(BrepsA=sph, BrepsB=extr_12)

# ----
preview_2 = CustomPreview(Geometry=sdiff_2, Shader=ColourSwatch(SwatchColor=RGB(145, 169, 255)))
sdiff_6 = SolidDifference(BrepsA=sdiff_4, BrepsB=extr_11)

# ---- group: top cap
addition_3 = Addition(A=tube_radius, B=tube_wall_thickness)
Z_19 = UnitZ(Factor=cam_plug_height)
cir_12 = Circle(Plane=pl_offset_2, Radius=addition_3)
move_9 = Move(Geometry=cir_12, Motion=expr("x*-0.5", Z_19))  # -> Geometry, Transform
boundary_14 = BoundarySurfaces(Edges=move_9.Geometry)
extr_13 = Extrude(Base=boundary_14, Direction=Z_19)

subtraction_3 = Subtraction(A=tube_radius, B=tube_wall_thickness)
Z_20 = UnitZ(Factor=cam_plug_height)
Z_21 = UnitZ(Factor=lens_groove_depth)
cir_13 = Circle(Plane=pl_offset_2, Radius=subtraction_3)
cir_14 = Circle(Plane=pl_offset_2, Radius=tube_radius)
move_10 = Move(Geometry=[cir_13, cir_14], Motion=expr("x*0.5", Z_20))  # -> Geometry, Transform
boundary_15 = BoundarySurfaces(Edges=move_10.Geometry)
extr_14 = Extrude(Base=boundary_15, Direction=expr("-x", Z_21))

# ----
sensor_tube = Geometry(tube_3)
camera_cap = Geometry(sdiff_6)
base_plug = Geometry(sdiff_2)
lens_tube = Geometry(tube)
reflector = Geometry(sdiff_5)
pi_tube = Geometry(tube_2)
pole = Geometry(sunion_3)

# ---- group: top cap
sdiff_7 = SolidDifference(BrepsA=extr_13, BrepsB=extr_14)
mirror = Mirror(Geometry=sdiff_7, Plane=pl_offset_2)  # -> Geometry, Transform
Z_22 = UnitZ(Factor=lens_tube_height)
move_11 = Move(Geometry=mirror.Geometry, Motion=Z_22)  # -> Geometry, Transform

# ----
top_cap = Geometry(move_11.Geometry)
merge = Merge(
    Data1=top_cap,
    Data2=reflector,
    Data3=lens_tube,
    Data4=camera_cap,
    Data5=pi_tube,
    Data6=base_plug,
    Data7=sensor_tube,
    Data8=pole)

# ==== cluster Tube
thickness = ClusterInput()
od = ClusterInput()
height = ClusterInput()
pln = ClusterInput()
thickness_2 = Number(thickness)
od_2 = Number(od)
height_2 = Number(height)
pln_2 = Plane(pln)
subtraction = Subtraction(A=od_2, B=thickness_2)
cir = Circle(Plane=pln_2, Radius=subtraction)
cir_2 = Circle(Plane=pln_2, Radius=od_2)
Z = UnitZ(Factor=height_2)
boundary = BoundarySurfaces(Edges=[cir, cir_2])
extr = Extrude(Base=boundary, Direction=Z)
capex = CapHolesEx(Brep=extr)  # -> Brep, Caps, Solid
tube = Brep(capex.Brep)
tube_2 = ClusterOutput(tube)
